# Grasshopper definition TEST - grid & shading def.gh (Grasshopper 0.9.76)
# plug-ins: IvyGh

d0_rw = ValueList({"0", "1", "2"}, selected="0")
d1_rh = ValueList({"0", "1", "2"}, selected="0")

r = Number(Tree({1}: [0.4, 0.5, 0.6], {2}: [0.26, 0.28, 0.3]))
txt = Text(["rw", "rh"])
panel = Panel(r)
panel_2 = Panel(txt)
grid = CreateGrid(InputRange=panel, Labels=panel_2)  # -> GridInfo, Grid
slider = GridSlider(grid=grid.Grid, D0=d0_rw, D1=d1_rh)  # -> Info, ActivePoint, ActiveCell, GridNodes
panel_3 = Panel(slider.Info)

d0_a1 = Slider(0, range=-25..25)
d1_a2 = Slider(0, range=-25..25)

A = Number(Tree({1}: [-25, 0, 25], {2}: [-25, 0, 25]))
txt_2 = Text(["A1", "A2"])
panel_4 = Panel(A)
panel_5 = Panel(txt_2)
grid_2 = CreateGrid(InputRange=panel_4, Labels=panel_5)  # -> GridInfo, Grid
slider_2 = GridSlider(grid=grid_2.Grid, D0=d0_a1, D1=d1_a2)  # -> Info, ActivePoint, ActiveCell, GridNodes
panel_6 = Panel(slider_2.Info)

g1xg2 = CartesianProduct(FirstGrid=grid.Grid, SecondGrid=grid_2.Grid)  # -> Info, CartesianProduct
t1xt2 = CartesianProductOfTuples(FirstTuple=slider.ActivePoint, SecondTuple=slider_2.ActivePoint)
point = PointOnGrid(Grid=g1xg2.CartesianProduct, PointCoordinates=t1xt2)  # -> PointCoordinates, CellNumber

normalize = Normalize(Grid=g1xg2.CartesianProduct)  # -> Info, Grid

# ---- group: Number of Faces
u1 = Slider(6, range=4..20)
u2 = Slider(12, range=4..20)
V = Slider(12, range=4..20)

# ----
w = Slider(0.6, range=0..1)
l = Slider(0.6, range=0.1..0.8)
h = Slider(0.25, range=0.1..0.8)

panel_7 = Panel(g1xg2.Info)
multiple_definition = CSharpScript(grid=grid.Grid, w=w, l=l, h=h, U1=u1, U2=u2, V=V, Reference="Z:\Public\GitHub\Ivy\src\IvyCore\bin\Release\IvyCore.dll")  # -> out, M, BC, A; inputs w: Double, l: Double, h: Double, U1: Int32, U2: Int32, V: Int32
# ---------- multiple_definition: C# ----------
    var topoGrid = (Grid) grid;
    Print(grid.GetType().ToString());

    //var range_rw = new double[3]{0.4, 0.5, 0.6};
    //var range_rh = new double[3]{0.26, 0.28, 0.3};


    //var data = new double[2][]{range_rw, range_rh};

    //Grid topoGrid = new Grid(data);
    Print("" + topoGrid.NodeCount);

    var meshProp = new int[3]{U1,U2,V};

    Mesh m;
    int[][] a;
    int[] b;
    double rw, rh;

    var m_list = new List<Mesh>();
    var a_list = new List<int[][]>();
    var b_list = new List<int[]>();

    for (int i = 0; i < topoGrid.NodeCount; i++)
    {
      var topoNode = topoGrid.Nodes[i];
      rw = topoNode[0];
      rh = topoNode[1];
      Print(rw + "," + rh);

      ShadingDevice(w, l, h, rw, rh, meshProp, out m, out a, out b);


      var a1 = new Line(m.Vertices[a[0][0]], m.Vertices[a[0][1]]);
      var a2 = new Line(m.Vertices[a[1][0]], m.Vertices[a[1][1]]);
      var bc = m.Vertices[b[0]];

      m_list.Add(m);
      a_list.Add(a);
      b_list.Add(b);
    }

    M = m_list;
    BC = b_list;
    A = a_list;
# ---------- multiple_definition: C# additional code ----------
  public void ShadingDevice(double w, double l, double h, double rw, double rh, int[] meshProp, out Mesh mesh, out int[][] A, out int[] BC)
  {
    // U1, U2, V = number of FACES in each direction
    // U1+1, U2+1, V+1 => number of VERTICIES in each direction
    var U1 = meshProp[0];
    var U2 = meshProp[1];
    var V = meshProp[2];


    Surface s1, s2;
    GetSurfaces(w, l, h, rw, rh, out s1, out s2);

    var P1 = GetUVGrid(s1, U1 + 1, V + 1);
    var P2 = GetUVGrid(s2, U2 + 1, V + 1);
    mesh = GetUVGridMerge(P1, P2);

    /*
    Print("edede");
    mesh = new Mesh();
    A = new int[2][];
    BC = new int[1];
    return;
*/

    // Actuator 1
    var a1_0 = 0;
    var a1_1 = V * ((U1 + 1) + (U2 + 1) - 1) + U1;
    var A1 = new int[2]{a1_0, a1_1};

    // Actuator 2
    var a2_0 = a1_1 - U1;
    var a2_1 = a1_0 + U1;
    var A2 = new int[2]{a2_0, a2_1};

    // Actuators array
    A = new int[2][]{A1,A2};

    // Boudary condition
    var bc = (V / 2) * ((U1 + 1) + (U2 + 1) - 1) + U1 / 2;
    BC = new int[1]{bc};
  }

  /// <summary>
  /// Define the two surfaces that build up a shading device.
  /// </summary>
  /// <param name="w"></param>
  /// <param name="l"></param>
  /// <param name="h"></param>
  /// <param name="rw"></param>
  /// <param name="rh"></param>
  /// <param name="S1"></param>
  /// <param name="S2"></param>
  /// <returns></returns>
  public void GetSurfaces(double w, double l, double h, double rw, double rh, out Surface S1, out Surface S2)
  {
    Point3d p0,p1,p2;

    var sweep = new Rhino.Geometry.SweepOneRail();

    /*
    Print("sdsmdlksmlkd");
    S1 = new Surface();
    S2 = new Surface();
    return;
*/

    // Create S1 cross section crv
    p0 = new Point3d(-w / 2, 0, 0);
    p1 = new Point3d(0, rw - Math.Sqrt(rw * rw - w * w / 4), 0);
    p2 = new Point3d(+w / 2, 0, 0);
    var cs1 = new Arc(p0, p1, p2);
    var cs2 = new Arc(p0, p1, p2);

    // Create S1 rail crv
    var alpha = Math.Asin(h / rh); // arc angle
    p0 = new Point3d(-w / 2, 0, 0);
    p1 = new Point3d(-w / 2, rh * (1 - Math.Cos(alpha / 2)), rh * Math.Sin(alpha / 2));
    p2 = new Point3d(-w / 2, rh * (1 - Math.Cos(alpha)), h);
    var r1 = new Arc(p0, p1, p2);

    // Create S1 by sweep
    S1 = sweep.PerformSweep(r1.ToNurbsCurve(), cs1.ToNurbsCurve())[0].Surfaces[0];

    // Create S2 cross section crv
    var axis = new Vector3d(1, 0, 0);
    var center = new Point3d(0, rh, 0);
    var xform = Transform.Rotation(-alpha, axis, center);
    cs2.Transform(xform);

    // Create S1 rail crv
    var dir = new Vector3d(0, 1, 0);
    var r2 = new Line(p2, p2 + l * dir);

    // Create S2 by sweep
    S2 = sweep.PerformSweep(r2.ToNurbsCurve(), cs2.ToNurbsCurve())[0].Surfaces[0];
  }

  /// <summary>
  /// Get a grid of points on a surface along U and V.
  /// </summary>
  /// <param name="S">Input surface.</param>
  /// <param name="nu">Number of points in U direction.</param>
  /// <param name="nv">Number of points un V direction.</param>
  /// <returns>A 2 dimensionnal array of points P[iv][iu] of dimension nu*nv.</returns>
  public Point3d[][] GetUVGrid(Surface S, int nu, int nv)
  {
    var Iu = S.Domain(0);
    var Iv = S.Domain(1);

    int index;
    double u,v,tu,tv;

    var pts = new Point3d[nv][];

    // Create a Grid of points
    for (int iv = 0; iv < nv; iv++)
    {
      pts[iv] = new Point3d[nu];
      tv = (double) iv / (nv - 1);
      v = (1 - tv) * Iv.T0 + tv * Iv.T1;
      for (int iu = 0; iu < nu; iu++)
      {
        index = iu + nu * iv;
        tu = (double) iu / (nu - 1);
        u = (1 - tu) * Iu.T0 + tu * Iu.T1;
        var pt = S.PointAt(u, v);
        pts[iv][iu] = pt;
      }
    }
    return pts;
  }

  /// <summary>
  /// Merge 2 compatible grids of points along their U dilmension.
  /// </summary>
  /// <param name="P1">The first grid of points of length nv x nu1.</param>
  /// <param name="P2">The second grid of points of length nv x nu2.</param>
  /// <returns>A mesh.</returns>
  public Mesh GetUVGridMerge(Point3d[][] P1, Point3d[][] P2)
  {
    Mesh mesh = new Mesh();
    //pts = new List<Point3d>();

    int nu1 = P1[0].Length;
    int nv1 = P1.Length;

    int nu2 = P2[0].Length;
    int nv2 = P2.Length;

    // Merge grid along u (nv1 = nv2)
    // remove the duplicates in line iu1 = nu1-1 | iu2 = 0
    int nv = nv1;
    int nu = nu1 + nu2 - 1;
    for (int iv = 0; iv < nv; iv++)
    {
      // Add P1 points
      for (int iu1 = 0; iu1 < nu1; iu1++)
      {
        //index = iu1 + nu * iv;
        mesh.Vertices.Add(P1[iv][iu1]);
        //pts.Add(P1[iv][iu1]);
      }

      // Add P2 points
      for (int iu2 = 1; iu2 < nu2; iu2++)
      {
        //index = (nu1 - 1) + (iu2 - 1) + nu * iv;
        mesh.Vertices.Add(P2[iv][iu2]);
        //pts.Add(P2[iv][iu2]);
      }
    }

    // create faces
    for (int iv = 0; iv < nv - 1; iv++)
    {
      for (int iu = 0; iu < nu - 1; iu++)
      {
        int A = iu + nu * iv;
        int B = A + 1;
        int C = iu + 1 + nu * (iv + 1);
        int D = C - 1;
        mesh.Faces.AddFace(A, B, C, D);
        //Print(String.Format("({0},{1},{2},{3})", A, B, C, D));
      }
    }

    return mesh;
  }
# ---------- end multiple_definition ----------
panel_8 = Panel(multiple_definition.out)
panel_9 = Panel(normalize.Info)
c_script = CSharpScript(M=multiple_definition.M, BC=multiple_definition.BC, A=multiple_definition.A, i=Slider(0, range=0..8))  # -> mesh, bc, a1, a2; inputs M: list of Mesh, BC: list, A: list, i: Int32
# ---------- c_script: C# ----------
    var b = ((int[]) BC[i]);

    var a = (int[][]) A[i];

    var a1_0 = a[0][0];
    var a1_1 = a[0][1];
    var a2_0 = a[1][0];
    var a2_1 = a[1][1];

    a1 = new Line(M[i].Vertices[a1_0], M[i].Vertices[a1_1]);
    a2 = new Line(M[i].Vertices[a2_0], M[i].Vertices[a2_1]);

    
    mesh = M[i];
    bc = M[i].Vertices[b[0]];
# ---------- end c_script ----------

# ---- group: ACTUATOR
pt = Point(c_script.bc)
line = Line([c_script.a1, c_script.a2])
sph = Sphere(Base=pt, Radius=0.01)
line_2 = Line(line)
preview = CustomPreview(Geometry=[line_2, sph], Shader=ColourSwatch(SwatchColor=RGB(0, 0, 255)))

# ---- group: INFO
mesh = Mesh(c_script.mesh)
faceb = FaceBoundaries(Mesh=mesh)
facen = FaceNormals(Mesh=mesh)  # -> Centers, Normals
demesh = DeconstructMesh(Mesh=mesh)  # -> Vertices, Faces, Colours, Normals
lng = ListLength(List=facen.Centers)
lng_2 = ListLength(List=demesh.Vertices)
deface = DeconstructFace(Face=demesh.Faces)  # -> CornerA, CornerB, CornerC, CornerD
series = Series(Start=1, Step=1, Count=lng)
series_2 = Series(Start=1, Step=1, Count=lng_2)
merge = Merge(Data1=graft(deface.CornerA), Data2=graft(deface.CornerB), Data3=graft(deface.CornerC), Data4=graft(deface.CornerD))  # -> simplify(Result)
int = Integer(series)
int_2 = Integer(series_2)
boundary = BoundarySurfaces(Edges=faceb)
face = TextTag(Location=facen.Centers, Text=int, Colour=ColourSwatch(SwatchColor=RGB(255, 255, 255)))
node = TextTag(Location=demesh.Vertices, Text=int_2, Colour=ColourSwatch(SwatchColor=RGB(0, 0, 0)))
preview_2 = CustomPreview(Geometry=mesh, Shader=ColourSwatch(SwatchColor=RGBA(0, 0, 0, 49)))
