# Grasshopper definition TEST - grid auto param.gh (Grasshopper 0.9.76)
# plug-ins: IvyGh

txt = Text(["rh", "rw"])
d0 = Slider(0, range=-2..2)
d1 = Slider(-1, range=-7..5)
panel = Panel(txt)
num = Number(Tree({1}: [-2, 1, 2], {2}: [-7, 5, 3, 1]))
grid = CreateGrid(InputRange=num, Labels=panel)  # -> GridInfo, Grid
grid_2 = Grid(grid.Grid)
slider = GridSlider(range=grid_2, D0=d0, D1=d1)  # -> Info, Point, Cell
panel_2 = Panel([slider.Point, slider.Cell])
panel_3 = Panel(grid.GridInfo)
