# Grasshopper definition TEST - lerp.gh (Grasshopper 0.9.76)
# plug-ins: IvyGh

md_slider = MDSlider(
    slider_value=Point(0.2448979592, 0.5670731707, 0.5),
    SliderMode=0,
    x_domain=Domain(0, 1),
    y_domain=Domain(0, 1),
    z_domain=Domain(0, 1))
lerp = GHComponentLerpTest(Point=md_slider)  # -> Point, Field, Cell, Info
crv = Curve(lerp.Cell)
pdecon = Deconstruct(Point=[lerp.Point, lerp.Field])  # -> flatten(XComponent), flatten(YComponent), flatten(ZComponent)
multiplication = Multiplication(A=pdecon.ZComponent, B=Slider(0.149, range=0..1))
pt = ConstructPoint(XCoordinate=pdecon.XComponent, YCoordinate=pdecon.YComponent, ZCoordinate=multiplication)
